test file "brightnessController_Test"
  coverage: Decision, SignalRange

suite "Sweeps"

  case "InitSingle" [baseline]
    model brightnessController, harness brightnessController_Harness1
    input "InitSinglePulse.mat", mapped to Input, In1 (active)
    baseline "InitSingleOutput.mat"
      Out1:1

  case "InitMultiple" [baseline]
    model brightnessController, harness brightnessController_Harness1
    input "InitMultiplePulse.mat", mapped to Input, In1 (active)
    baseline "InitMultipleOutput.mat"
      Out1:1

suite "Sequences"

  case "InitSinglePulse" [baseline]
    model brightnessController, harness brightnessController_Harness2